# Grasshopper definition gh_test.gh (Grasshopper 1.0.7)

# ----
# Select Script
# Filepath
file_path = FilePath()
read_file = ReadFile(File=file_path, PerLineParse=False)

ghpython_script = GhPythonScript(Code=read_file)  # -> Out, A
messages = Panel(ghpython_script.Out)
