# Grasshopper definition gh_test_updateColors.gh (Grasshopper 1.0.7)
# plug-ins: Human

# ----
# Select Script
# Filepath
file_path = FilePath("E:\ITECH\Semester 1\Computational Design\Github - Clone\Computational-Design-Assignment\wandering_agents_3D.py")
read_file = ReadFile(File=file_path, PerLineParse=False)

# ----
# In case error: float has no attribute Length
# press reset button a couple of times
button = Button()

trigger = Trigger(Interval=1, TimerInterval=5, Target=ghpython_script)  # disabled
ghpython_script = GhPythonScript(Code=read_file, IReset=button)  # -> Out, OGeometry, OPredatorPath, OBoundaryBox
messages = Panel(ghpython_script.Out)
previewlw = CustomPreviewLineweights(Geometry=ghpython_script.OGeometry, Shader=ColourSwatch(SwatchColor=RGB(255, 255, 255)), Absolute=False)
previewlw_2 = CustomPreviewLineweights(Geometry=ghpython_script.OPredatorPath, Shader=ColourSwatch(SwatchColor=RGB(255, 0, 255)), Absolute=False)
